# Grasshopper definition load_data.gh (Grasshopper 1.0.7)
# Copyright: Job de Vogel

trigger = Trigger(Interval=5000, TimerInterval=5000, Target=ghpython_script)  # disabled
file_path = FilePath("C:\Users\Job de Vogel\OneDrive\Documenten\TU Delft\Master Thesis\Dataset_pipeline\3D_BAG_dataset\3dbag_v210908_fd2cee53_lod12_3d_5859.obj")
ghpython_script = GhPythonScript()  # -> out, idx, meshes, outlines, sensors, meta
# ---------- ghpython_script: Python ----------
__author__ = "Job de Vogel"
__version__ = "2023.07.26"

import Rhino.Geometry as rg
import ghpythonlib.treehelpers as th
import json

import glob
import os

# Load a mesh from a json file
def load_mesh_from_json(path, mesh_types):
#    path = folder + "/" + name + ".json"
    with open(path, "r") as file:
        data = json.load(file)

    if isinstance(mesh_types, str):
        if mesh_types == 'meta':
            return data['meta']
        else:
            return [rg.Mesh.FromJSON(data[mesh_types])], data['meta']
    else:
        meta = data['meta']
        data.pop('meta')
        meshes = []
        
        for key in data.keys():
            meshes.append(rg.Mesh.FromJSON(data[key]))
        
        return meshes, meta

def load_array_as_list(path):
    with open(path, 'r') as file:
        data = json.load(file)
    
    data = json.loads(data)
        
    # with open(file, 'rb') as file:
    #     data = pickle.load(file)
    
    return data

# Load a mesh from a json file
def load_outlines_from_json(path):
    with open(path, "r") as file:
        data = json.load(file)

    curves = []
    for key in data.keys():
        curves.append(rg.NurbsCurve.FromJSON(data[key]))

    return curves

path = 'C:\\Users\\Job de Vogel\\OneDrive\\Documenten\\TU Delft\\Master Thesis\\Dataset_pipeline\\dataset\\data\\geometry'
files = os.listdir(path)
paths = [os.path.join(path, basename) for basename in files]
latest_mesh = max(paths, key=os.path.getctime)
splitted_path = latest_mesh.split("\\")
idx = int(splitted_path[len(splitted_path) - 1][5:-5])

path = 'C:\\Users\\Job de Vogel\\OneDrive\\Documenten\\TU Delft\\Master Thesis\\Dataset_pipeline\\dataset\\data\\irradiance'
files = os.listdir(path)
paths = [os.path.join(path, basename) for basename in files]
latest_sensors = max(paths, key=os.path.getctime)
sensors = th.list_to_tree(load_array_as_list(latest_sensors))

path = 'C:\\Users\\Job de Vogel\\OneDrive\\Documenten\\TU Delft\\Master Thesis\\Dataset_pipeline\\dataset\\data\\outlines'
files = os.listdir(path)
paths = [os.path.join(path, basename) for basename in files]
latest_outlines = max(paths, key=os.path.getctime)
outlines = load_outlines_from_json(latest_outlines)

mesh_types = ['ground', 'walls', 'roofs']

meshes, meta = load_mesh_from_json(latest_mesh, mesh_types)

meshes = th.list_to_tree(meshes)
# ---------- end ghpython_script ----------
panel = Panel(file_path)
python_script = PythonScript(File_Paths=file_path, Translate=Toggle(True), Level_Ground=Toggle(True), parallel=Toggle(False), run=Toggle(True))  # -> out, mesh, local_meshes, roof_meshes, wall_meshes, bbox; inputs File_Paths: list
# ---------- python_script: Python ----------
import Rhino.Geometry as rg
from ghpythonlib import parallel
from ghpythonlib import treehelpers

import warnings
import sys

def load_obj(path):
    with open(path) as file:
        lines = file.readlines()
    
    vertices=[]
    faces=[]
    
    for line in lines:
        if line.find("v")==0 and line.find("n")==-1 and line.find("t")==-1:
            vertices.Add(rg.Point3d(float((line.split(' '))[1]),float((line.split(' '))[2]),float((line.split(' '))[3])))
        if line.find("f")==0:
            if line.split(' ').Count==4:
                faces.Add(rg.MeshFace(int(line.split(' ')[1].split('/')[0])-1,int(line.split(' ')[2].split('/')[0])-1,int(line.split(' ')[3].split('/')[0])-1))
            if line.split(' ').Count==5:
                faces.Add(rg.MeshFace(int(line.split(' ')[1].split('/')[0])-1,int(line.split(' ')[2].split('/')[0])-1,int(line.split(' ')[3].split('/')[0])-1,int(line.split(' ')[4].split('/')[0])-1))
    
    mesh = rg.Mesh()
    for vertex in vertices:
        mesh.Vertices.Add(vertex)
    
    for face in faces:
        mesh.Faces.AddFace(face)
    
    mesh.Normals.ComputeNormals()
    mesh.Compact()
    mesh.MergeAllCoplanarFaces(0.01)
    
    return mesh

def translate_mesh(mesh, bbox):
    center = bbox.Center
    x, y = center[0], center[1]

    mesh.Translate(-x, -y, 0)
    brepBoundingBox = bbox.ToBrep()
    brepBoundingBox.Translate(-x, -y, 0)
    
    return mesh, brepBoundingBox

def get_bbox(mesh):
    xyPlane = rg.Plane(rg.Point3d(0.0, 0.0, 0.0), rg.Vector3d(0.0, 0.0, 1.0))
    boundingBox = mesh.GetBoundingBox(xyPlane)
    
    return boundingBox

def partition_mesh(mesh):
    roofMesh = rg.Mesh()
    roofMesh.CopyFrom(mesh)
    roofFacesIdxs = []
    
    wallMesh = rg.Mesh()
    wallMesh.CopyFrom(mesh)
    wallFacesIdxs = []
    
    floorMesh = rg.Mesh()
    floorMesh.CopyFrom(mesh)
    floorFacesIdxs = []
    
    for i, normal in enumerate(mesh.FaceNormals):
        if normal.Z > 0:
            roofFacesIdxs.append(i)
        elif normal.Z == 0:
            wallFacesIdxs.append(i)
        else:
            floorFacesIdxs.append(i)
    
    valid = True
    if len(floorFacesIdxs) == 0 or len(wallFacesIdxs) == 0 or len(roofFacesIdxs) == 0:
        valid = False
        warnings.warn("File contains meshes without roofs, walls or floors.")
        
        return valid, roofMesh, wallMesh, floorMesh
        
    roofMesh.Faces.DeleteFaces(wallFacesIdxs + floorFacesIdxs)
    wallMesh.Faces.DeleteFaces(roofFacesIdxs + floorFacesIdxs)
    floorMesh.Faces.DeleteFaces(roofFacesIdxs + wallFacesIdxs)
    
    roofMesh.Compact()
    wallMesh.Compact()
    floorMesh.Compact()
    
    return valid, roofMesh, wallMesh, floorMesh

def level_mesh(mesh, roof_mesh, wall_mesh, floor_mesh):
    height = floor_mesh.Faces.GetFaceCenter(0).Z
    
    mesh.Translate(0, 0, -height)
    roof_mesh.Translate(0, 0, -height)
    wall_mesh.Translate(0, 0, -height)
    floor_mesh.Translate(0, 0, -height)
    
    return mesh, roof_mesh, wall_mesh, floor_mesh

def main(path):
    mesh = load_obj(path)
    
    if Translate:
        mesh, bbox = translate_mesh(mesh, get_bbox(mesh))
    else:
        bbox = get_bbox(mesh)
    
    if Level_Ground:
        global_mesh = rg.Mesh()
    else:
        global_mesh = mesh

    local_meshes = []
    local_roof_meshes = []
    local_wall_meshes = []
    local_floor_meshes = []
    
    for i, local_mesh in enumerate(mesh.SplitDisjointPieces()):
        valid, roof_mesh, wall_mesh, floor_mesh = partition_mesh(local_mesh)
        
        if not valid:
            continue
        
        if Level_Ground:
            local_mesh, roof_mesh, wall_mesh, floor_mesh = level_mesh(local_mesh, roof_mesh, wall_mesh, floor_mesh)
            global_mesh.Append(local_mesh)
        
        local_meshes.append(local_mesh)
        local_roof_meshes.append(roof_mesh)
        local_wall_meshes.append(wall_mesh)
        local_floor_meshes.append(floor_mesh)

    return mesh, local_meshes, local_roof_meshes, local_wall_meshes, local_floor_meshes, bbox

if __name__ == '__main__':
    if run:
        if parallel:
            if len(File_Paths) == 1:
                mesh, local_meshes, roof_meshes, wall_meshes, floor_meshes, bbox = main(File_Paths[0])
            else:
                results = parallel.run(main, File_Paths, False)
                mesh, local_meshes, roof_meshes, wall_meshes, floor_meshes, bbox = list(zip(*results))
                
                mesh = treehelpers.list_to_tree(mesh, source=[0])
                local_meshes = treehelpers.list_to_tree(local_meshes, source=[0])
                roof_meshes = treehelpers.list_to_tree(roof_meshes, source=[0])
                wall_meshes = treehelpers.list_to_tree(wall_meshes, source=[0])
                floor_meshes = treehelpers.list_to_tree(floor_meshes, source=[0])
                bbox = treehelpers.list_to_tree(bbox, source=[0])
        else:
            if len(File_Paths) == 1:
                mesh, local_meshes, roof_meshes, wall_meshes, floor_meshes, bbox = main(File_Paths[0])
            else:
                mesh = []
                local_meshes = []
                roof_meshes = []
                wall_meshes = []
                floor_meshes = []
                bbox = []
                for file in File_Paths:
                    tmp_mesh, tmp_local_meshes, tmp_roof_meshes, tmp_wall_meshes, tmp_floor_meshes, tmp_bbox = main(file)
                    mesh.append(tmp_mesh)
                    local_meshes.append(tmp_local_meshes)
                    roof_meshes.append(tmp_roof_meshes)
                    wall_meshes.append(tmp_wall_meshes)
                    floor_meshes.append(tmp_floor_meshes)
                    bbox.append(tmp_bbox)
                
                mesh = treehelpers.list_to_tree(mesh, source=[0])
                local_meshes = treehelpers.list_to_tree(local_meshes, source=[0])
                roof_meshes = treehelpers.list_to_tree(roof_meshes, source=[0])
                wall_meshes = treehelpers.list_to_tree(wall_meshes, source=[0])
#                floor_meshes = treehelpers.list_to_tree(floor_meshes, source=[0])
                bbox = treehelpers.list_to_tree(bbox, source=[0])
# ---------- end python_script ----------
envelope_size = Slider(100, range=0..1000)
minimum_coverage = Slider(25, range=0..100)
list_item = ListItem(List=ghpython_script.sensors, Index=0, Wrap=True)  # -> Item, Item1, Item2, Item3, Item4, Item5, Item6
construct_point = ConstructPoint(XCoordinate=list_item.Item, YCoordinate=list_item.Item1, ZCoordinate=list_item.Item2)
vector_xyz = VectorXYZ(XComponent=list_item.Item3, YComponent=list_item.Item4, ZComponent=list_item.Item5)  # -> Vector, Length
idx = Panel(ghpython_script.idx)
data = Data(python_script.mesh)
ghpython_script_2 = GhPythonScript(bbox=python_script.bbox, size=envelope_size, min_coverage=minimum_coverage)  # -> out, ground_outlines; inputs bbox: Box
# ---------- ghpython_script_2: Python ----------
__author__ = "Job de Vogel"
__version__ = "2023.04.25"

import Rhino.Geometry as rg
import random

# Get the x,y domain of a bbox
def get_domain(bbox):
    print(bbox.GetCorners())
    x, y, _ = list(map(list, zip(*bbox.GetCorners())))
    print('\n')
    print(x,y)
    
    min_x = min(x)
    min_y = min(y)
    max_x = max(x)
    max_y = max(y)
    
    return (min_x, max_x), (min_y, max_y)

# Divide main domain into sub domains
def divide_domain(domain, size, min_coverage):
    min_x, max_x = domain[0]
    min_y, max_y = domain[1]
    
    x_size = abs(min_x) + abs(max_x)
    y_size = abs(min_y) + abs(max_y)
    
    step_size = size * min_coverage / 100
    x_steps = (x_size // step_size) - 1
    y_steps = (y_size // step_size) - 1
    
    sub_domains = []
    for i in range(int(x_steps)):
        for j in range(int(y_steps)):
            x_domain = (min_x + i * step_size, min_x + i * step_size + size)
            y_domain = (min_y + j * step_size, min_y + j * step_size + size)
            
            sub_domains.append((x_domain, y_domain))
    
    return sub_domains

# Generate bbox from domain and size
def create_bbox(domain, bottom_treshold):
    x_domain, y_domain = domain
    x_center = (x_domain[0] + x_domain[1]) / 2
    y_center = (y_domain[0] + y_domain[1]) / 2
    
    size = abs(x_domain[1] - x_domain[0])
    
    center = rg.Point3d(x_center, y_center, 0)
    plane = rg.Plane(center, rg.Vector3d(0, 0, 1))
    
    interv = rg.Interval(-0.5 * size, 0.5 * size)
    z_interv = rg.Interval(-0.1, size + 0.1)

    box = rg.Box(plane, interv, interv, z_interv)
    return box

def main():
    main_domain = get_domain(bbox)
    sub_domains = divide_domain(main_domain, size, min_coverage)
    
    outlines = []
    for domain in sub_domains:
        corner_0 = rg.Point3d(domain[0][0], domain[1][0], 0)
        corner_1 = rg.Point3d(domain[0][1], domain[1][1], 0)
        outlines.append(rg.Rectangle3d(rg.Plane.WorldXY, corner_0, corner_1))

    return outlines

ground_outlines = main()
# ---------- end ghpython_script_2 ----------
mesh_edges = MeshEdges(Mesh=python_script.local_meshes)  # -> NakedEdges, InteriorEdges, NonManifoldEdges
list_item_2 = ListItem(List=ghpython_script_2.ground_outlines, Index=ghpython_script.idx, Wrap=True)
custom_preview = CustomPreview(Geometry=data, Material=ColourSwatch(SwatchColor=RGBA(181, 0, 0, 65)))
area = Area(Geometry=list_item_2)  # -> Area, Centroid
custom_preview_2 = CustomPreview(Geometry=mesh_edges.InteriorEdges, Material=ColourSwatch(SwatchColor=RGB(255, 255, 255)))
vector_2pt = Vector2Pt(PointA="0,0,0", PointB=area.Centroid, Unitize=False)  # -> Vector, Length
move = Move(Geometry=ghpython_script.meshes, Motion=vector_2pt.Vector)  # -> Geometry, Transform; disabled
move_2 = Move(Geometry=ghpython_script.outlines, Motion=vector_2pt.Vector)  # -> Geometry, Transform; disabled
move_3 = Move(Geometry=construct_point, Motion=vector_2pt.Vector)  # -> Geometry, Transform; disabled
vector_display = VectorDisplay(Anchor=move_3.Geometry, Vector=vector_xyz.Vector)  # disabled
list_item_3 = ListItem(List=move.Geometry, Index=0, Wrap=True)  # -> Item, Item1, Item2; disabled
colour_swatch = ColourSwatch(SwatchColor=RGB(255, 255, 255))  # disabled
colour_swatch_2 = ColourSwatch(SwatchColor=RGB(255, 0, 0))  # disabled
colour_swatch_3 = ColourSwatch(SwatchColor=RGB(51, 219, 0))  # disabled
colour_swatch_4 = ColourSwatch(SwatchColor=RGB(255, 255, 0))  # disabled
panel_2 = Panel([list_item_3.Item, list_item_3.Item1, list_item_3.Item2])  # disabled
face_normals = FaceNormals(Mesh=[list_item_3.Item, list_item_3.Item1, list_item_3.Item2])  # -> Centers, Normals; disabled
custom_preview_3 = CustomPreview(Geometry=list_item_3.Item, Material=colour_swatch_2)  # disabled
custom_preview_4 = CustomPreview(Geometry=list_item_3.Item1, Material=colour_swatch_4)  # disabled
custom_preview_5 = CustomPreview(Geometry=list_item_3.Item2, Material=colour_swatch_3)  # disabled
custom_preview_6 = CustomPreview(Geometry=move_3.Geometry, Material=colour_swatch)  # disabled
amplitude = Amplitude(Vector=face_normals.Normals, Amplitude=5)  # disabled
vector_display_2 = VectorDisplay(Anchor=face_normals.Centers, Vector=amplitude)  # disabled
colour_swatch_5 = ColourSwatch(SwatchColor=RGB(255, 255, 255))
mesh_join = MeshJoin(Meshes=ghpython_script.meshes)
legendpar = LBLegendParameters(
    seg_count=Slider(20, range=0..100),
    colors=[ColourSwatch(SwatchColor=RGB(134, 144, 252)), ColourSwatch(SwatchColor=RGB(247, 228, 10)), ColourSwatch(SwatchColor=RGB(189, 88, 51)), ColourSwatch(SwatchColor=RGB(212, 49, 0))],
    continuous_leg=Toggle(True),
    num_decimals=Slider(0, range=0..100))  # -> leg_par; plug-in component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
heatmap = LBSpatialHeatmap(
    values=flatten(list_item.Item6),
    mesh=mesh_join,
    legend_par=legendpar,
    legend_title="(kWh/m2)",
    global_title="Solar Irradiance Simulation")  # -> mesh, legend, title, colors, legend_par; plug-in component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
move_4 = Move(Geometry=heatmap.mesh, Motion=vector_2pt.Vector)  # -> Geometry, Transform

# ---- group: RH_OUT:mesh
mesh = Mesh(move_4.Geometry)
